% Simulink data dictionary wind_parameters.sldd
% references wind_parameters.sldd

wd = 0
Lu = 200
Lv = 200
Lw = 50
sigma_u = 1.06
sigma_v = 1.06
sigma_w = 0.7

AP = struct(
  gravity=9.81,
  tau=0.05,
  Va0=34.9901,
  Ts=0.01,
  delta_a_max=0.7853982,
  e_phi_max=0.2617994,
  zeta_phi=3.85,
  zeta_course=1.85,
  delta_r_max=0.7853982,
  e_beta_max=0.2617994,
  zeta_sideslip=0.8,
  delta_e_max=0.7853982,
  e_theta_max=0.1745329,
  zeta_theta=0.6,
  W_h=43,
  zeta_h=1.8,
  W_V2=13,
  zeta_V2=1.9,
  zeta_V=2,
  omega_n_V=0.8,
  roll_kp=3,
  omega_n_phi=21.25379,
  roll_kd=0.8719438,
  sideslip_kp=3,
  sideslip_ki=4.470287,
  d_beta=2.923766e-05,
  omega_n_dr=6.324084,
  p_wo=0.6324084,
  yaw_damper_tau_r=1.581257,
  yaw_damper_kp=0.1405517,
  omega_n_chi=0.2108028,
  course_kp=2.781981,
  course_ki=0.1584999,
  d_chi=-1.125e-12,
  pitch_kp=-4.5,
  omega_n_theta=22.67773,
  pitch_kd=-0.2797815,
  K_theta_DC=0.61918,
  omega_n_h=0.5273891,
  altitude_ki=0.01283809,
  altitude_kp=0.0876338,
  d_h=0.02173983,
  omega_n_V2=1.744441,
  kp_V2=-1.028441,
  ki_V2=-0.5009872,
  ki_V=0.06533594,
  kp_V=0.2876856)

A_lat = [-0.9207696 0.082 -34.99 9.482803 0
 -5.420138 -32.36163 15.30916 0 0
 1.09766 -4.227954 -1.723456 0 0
 0 1 -0.2649511 0 0
 0 0 1.034504 0 0]

A_lon = [-0.3812914 0.2512991 -0.08003649 -9.482803 0
 -0.5270783 -6.272082 34.15216 2.512479 0
 0.01291602 -5.597224 -7.415219 0 0
 0 0 1 0 0
 0.256114 0.9666466 0 -33.80196 0]

B_lat = [2.911249 7.375163; 150.5746 -3.524249; 2.563059 -48.8139; 0 0; 0 0]
B_lon = [-0.5121975 9.795528; -5.047378 0; -70.76258 0; 0 0; 0 0]
R = Inf
SIM = struct(ts_simulation=0.01, ts_control=0.01, ts_plotting=0.1, ts_video=0.1, start_time=0, end_time=500)
T_Va_delta_t = tf(num={[0 9.795528]}, den={[1 0.3819679]}, Ts=0)
T_Va_theta = tf(num={[0 -9.476999]}, den={[1 0.3819679]}, Ts=0)
T_chi_phi = tf(num={[0 0.280365]}, den={[1 0]}, Ts=0)
T_h_Va = tf(num={[0 -0.259]}, den={[1 0]}, Ts=0)
T_h_theta = tf(num={[0 34.9901]}, den={[1 0]}, Ts=0)
T_phi_delta_a = tf(num={[0 0 150.5746]}, den={[1 32.36163 0]}, Ts=0)
T_theta_delta_e = tf(num={[0 0 -70.76258]}, den={[1 7.415219 195.8479]}, Ts=0)
T_v_delta_r = tf(num={[0 0.2107786]}, den={[1 0.9207696]}, Ts=0)
dx_trim = [33.8074; 1.259181e-05; 9.058667; 0; 0; 0; 0; 0; 0; 0; 0; 0]
gamma = 0.2617994
tout = [13.09; 13.09163; 13.09333; 13.09503; 13.09667; 13.0983; 13.1; 13.1017; 13.10333; 13.10497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 14.75503]

trans_func = tf(
  num={[0 0 150.5746], [0 0.280365], [0 0 -70.76258], [0 34.9901], [0 -0.259], [0 9.795528], [0 -9.476999], [0 0.2107786]},
  den={[1 32.36163 0], [1 0], [1 7.415219 195.8479], [1 0], [1 0], [1 0.3819679], [1 0.3819679], [1 0.9207696]},
  Delay=struct(Input=repmat(0, 8, 1), Output=0, IO=repmat(0, 1, 8)),
  Ts=0)

u_trim = [0.0072; 0.00084; -0.000134; 0.85]

vtol = struct(
  Va0=35,
  Ts=0.01,
  pn0=0,
  pe0=0,
  pd0=-100,
  u0=34.99,
  v0=0,
  w0=0.082,
  phi0=-0.00015,
  theta0=-0.259,
  psi0=0,
  p0=0,
  q0=0,
  r0=0,
  gravity=9.81,
  mass=11,
  Jx=0.8244,
  Jy=1.135,
  Jz=1.759,
  Jxz=0.1204,
  S_wing=0.55,
  b=2.9,
  c=0.19,
  S_prop=0.2027,
  rho=1.2682,
  e=0.9,
  AR=15.29091,
  Gamma=1.43562344,
  Gamma1=0.1214715,
  Gamma2=0.7746545,
  Gamma3=1.225252,
  Gamma4=0.083866,
  Gamma5=0.8234361,
  Gamma6=0.1060793,
  Gamma7=-0.1682631,
  Gamma8=0.5742453,
  C_L_0=0.23,
  C_D_0=0.043,
  C_m_0=0.0135,
  C_L_alpha=5.61,
  C_D_alpha=0.03,
  C_m_alpha=-2.74,
  C_L_q=7.95,
  C_D_q=0,
  C_m_q=-38.21,
  C_L_delta_e=0.13,
  C_D_delta_e=0.0135,
  C_m_delta_e=-0.99,
  M=50,
  alpha0=0.47,
  epsilon=0.16,
  C_D_p=0,
  C_Y_0=0,
  C_ell_0=0,
  C_n_0=0,
  C_Y_beta=-0.83,
  C_ell_beta=-0.13,
  C_n_beta=0.073,
  C_Y_p=0,
  C_ell_p=-0.51,
  C_n_p=-0.069,
  C_Y_r=0,
  C_ell_r=0.25,
  C_n_r=-0.095,
  C_Y_delta_a=0.075,
  C_ell_delta_a=0.1,
  C_n_delta_a=-0.011,
  C_Y_delta_r=0.19,
  C_ell_delta_r=0.0024,
  C_n_delta_r=-0.069,
  D_prop=0.508,
  K_V=145,
  KQ=0.0659,
  R_motor=0.042,
  i0=1.5,
  ncells=12,
  V_max=44.4,
  C_Q2=-0.01664,
  C_Q1=0.00497,
  C_Q0=0.00523,
  C_T2=-0.1079,
  C_T1=-0.06044,
  C_T0=0.09357,
  x_trim=[0; 0; 0; 34.99; 0; 0.082; -0.00015; -0.259; 0; 0; 0; 0],
  u_trim=[0.0072; 0.00084; -0.000134; 0.85],
  Va_trim=34.9901)

wgust = struct(wind_n=3, wind_e=2, wind_d=0, L_u=200, L_v=200, L_w=50, sigma_u=1.06, sigma_v=1.06, sigma_w=0.7, Va0=5)
x_trim = [0; 0; 0; 34.99; 0; 0.082; -0.00015; -0.259; 0; 0; 0; 0]
y_trim = [35; 0.0023; 0]
wn = 0
we = 0.1
W_vao = 0.1